# Grasshopper definition text2toolpath.gh (Grasshopper 0.9.56)
# plug-ins: gHowl

# ---- group: receiving msg from p5
# Receive Tweets from Processing through OSC
netsource = NetworkSource()  # -> NetworkAdapterIsUp, AdapterProperties, LocalIpAddress
address_for_gh = Panel(netsource.LocalIpAddress)
port = Panel("16000")
send_pattern_osc = Panel("999")
udp = UDPReceiver(Address=address_for_gh, Port=port, Pattern=send_pattern_osc)  # -> Info, Data
osc_data = Panel(udp.Data)

# ---- group: get current position of the robot
osc_d = OSCDispatch(OSCDevices="/pos", OSCMessage=osc_data)  # -> OSCDevice, OSCData
robot_currpos = Point(osc_d.OSCData)

# ---- group: get tweeted msg
osc_d_2 = OSCDispatch(OSCDevices="/msg", OSCMessage=osc_data)  # -> OSCDevice, OSCData
tweet = Panel(osc_d_2.OSCData)
split = TextSplit(Text=tweet, Separators=",")
lng = ListLength(List=split)
series = Series(Start=1, Step=1, Count=expr("c-2", lng))
item = ListItem(List=split, Index=series, Wrap=True)

# ----
sample_text_as_list_of_words = Panel("""happy
holidays
from
madlab""")
message_from_twitter_as_a_list_of_words = Panel(item)
word_count = ListLength(List=sample_text_as_list_of_words)
word_count_2 = ListLength(List=message_from_twitter_as_a_list_of_words)

# ---- group: sample fonts
panel = Panel("Moon Flower")
panel_2 = Panel("Modern")
panel_3 = Panel("OrachTechDemo1Lttf")

# ----
# Turn Text to Curves
number_slider = Slider(10, range=-30..30)
bool = Boolean(False)

# ---- group: txt2crv (from giuliopiacentino.com/grasshopper-tools)
bool_2 = Boolean(False)
txtpt = Point(Point(0, 0, 0))
c_script = CSharpScript(face=panel_2, bold=bool_2, italics=bool, size=number_slider, content=message_from_twitter_as_a_list_of_words, pl=txtpt)  # -> out, A; inputs face: String, bold: Boolean, italics: Boolean, size: Double, content: String, pl: Plane
# ---------- c_script: C# ----------
    if(size == 0)
      size = 1;

    if(!string.IsNullOrEmpty(face) && size > 0 && !string.IsNullOrEmpty(content) &&
      pl.IsValid)
    {

      var te = RhinoDoc.ActiveDoc.Objects.AddText(content, pl, size, face, bold, italics);
      Rhino.DocObjects.TextObject txt = RhinoDoc.ActiveDoc.Objects.Find(te) as Rhino.DocObjects.TextObject;

      if(txt != null)
      {
        var tt = txt.Geometry as Rhino.Geometry.TextEntity;
        A = tt.Explode();
      }

      RhinoDoc.ActiveDoc.Objects.Delete(te, true);
    }
# ---------- end c_script ----------

# ---- group: set the origin point
robot_currpos_2 = Point(osc_d.OSCData)
dummypt = Point(Point(0, 0, 0))
# Dynamic Layout for the Robot
robot_center_point = Point(dummypt)

# ----
word_count_3 = Integer(word_count_2)

# ----
# create the robot's working (XY) plane
pdecon = Deconstruct(Point=robot_center_point)  # -> XComponent, YComponent, ZComponent
xreach = Slider(238, range=0..1000)
yreach = Slider(320, range=0..1000)
subtraction = Subtraction(A=pdecon.XComponent, B=xreach)
addition = Addition(A=pdecon.XComponent, B=xreach)
subtraction_2 = Subtraction(A=pdecon.YComponent, B=yreach)
addition_2 = Addition(A=pdecon.XComponent, B=yreach)
width = ConstructDomain(DomainStart=subtraction, DomainEnd=addition)
height = ConstructDomain(DomainStart=subtraction_2, DomainEnd=addition_2)
pl = ConstructPlane(Origin=robot_center_point, XAxis=Vector(1, 0, 0), YAxis=Vector(0, 1, 0))
planesrf = PlaneSurface(Plane=pl, XSize=width, YSize=height)

panel_4 = Panel("make rows")
word_count_4 = Integer(word_count_3)
sdivide = DivideSurface(Surface=planesrf, UCount=1, VCount=word_count_4)  # -> Points, Normals, Parameters
rev = ReverseList(List=sdivide.Points)  # -> flatten(List)
dom = ConstructDomain(DomainStart=0, DomainEnd=word_count_4)
subset = SubList(List=rev, Domain=dom, Wrap=False)  # -> List, Index
points = PointList(Points=subset.List, Tags=True, Lines=True, Size=Slider(19, range=10..50))

# ----
# move each word to a row
msg = Curve(c_script.A)
textpt = Point(txtpt)
rowpts = Point(subset.List)
shift = ShiftList(List=rowpts, Shift=1, Wrap=False)
ln = Line(StartPoint=textpt, EndPoint=shift)  # -> graft(Line)
move = Move(Geometry=msg, Motion=ln)  # -> Geometry, Transform

# ---- group: even spacing
rev_2 = ReverseList(List=rowpts)
item_2 = ListItem(List=rev_2, Index=0, Wrap=True)
item_3 = ListItem(List=rowpts, Index=0, Wrap=True)
dist = Distance(PointA=item_3, PointB=item_2)
lng_2 = ListLength(List=rev_2)
_1 = Integer(1)
subtraction_3 = Subtraction(A=lng_2, B=_1)
division = Division(A=dist, B=subtraction_3)

# ---- group: midPt of working plane
pdecon_2 = Deconstruct(Point=textpt)  # -> XComponent, YComponent, ZComponent
pdecon_3 = Deconstruct(Point=rowpts)  # -> XComponent, YComponent, ZComponent
subtraction_4 = Subtraction(A=pdecon_2.XComponent, B=pdecon_3.XComponent)

# ----
panel_5 = Panel("center each word")

# ----
# scale each word based on column height
# Adjust SEED value to see alternative layouts.
number_slider_2 = Slider(12, range=0..50)
even_spacing = Number(division)
rowpts_2 = Point(rowpts)

# ---- group: select 2 random indices to vertically adjust
word_count_5 = Integer(word_count_3)
_2 = Integer(2)
_1_2 = Integer(1)
random = Random(Range=Domain(0, 1), Number=_2, Seed=number_slider_2)
subtraction_5 = Subtraction(A=word_count_5, B=_1_2)
multiplication = Multiplication(A=random, B=subtraction_5)
_1_3 = Integer(1)
integer_division = IntegerDivision(A=multiplication, B=_1_3)
panel_6 = Panel(integer_division)

# ---- group: rest of indices to adjust
lng_3 = ListLength(List=rowpts)
series_2 = Series(Start=1, Step=1, Count=expr("c-2", lng_3))
cull_i = CullIndex(List=series_2, Indices=expr("i-1", panel_6), Wrap=False)
panel_7 = Panel(cull_i)

# ---- group: smaller spacing
item_4 = ListItem(List=panel_6, Index=1, Wrap=True)
division_2 = Division(A=even_spacing, B=Slider(10, range=0.1..10))
Y = UnitY(Factor=expr("-1*F", division_2))
item_5 = ListItem(List=rowpts, Index=item_4, Wrap=True)
move_2 = Move(Geometry=item_5, Motion=Y)  # -> Geometry, Transform

# ---- group: larger spacing
item_6 = ListItem(List=panel_6, Index=0, Wrap=True)
division_3 = Division(A=even_spacing, B=Slider(3, range=0.1..10))
item_7 = ListItem(List=rowpts, Index=item_6, Wrap=True)
Y_2 = UnitY(Factor=division_3)
move_3 = Move(Geometry=item_7, Motion=Y_2)  # -> Geometry, Transform

# ---- group: rotate to match robot coordinate system
# generate toolpaths from letters
robot_center_point_2 = Point(robot_center_point)
X = UnitX(Factor=1)
line = LineSDL(Start=robot_center_point_2, Direction=X, Length=1)
Y_3 = UnitY(Factor=1)
Z = UnitZ(Factor=1)
line_2 = LineSDL(Start=robot_center_point_2, Direction=Y_3, Length=1)
line_3 = LineSDL(Start=robot_center_point_2, Direction=Z, Length=1)

# ----
larger_spacing = Number(division_3)
smaller_spacing = Number(division_2)
replace = ReplaceItems(List=rowpts_2, Item=move_3.Geometry, Indices=item_6, Wrap=False)
replace_2 = ReplaceItems(List=replace, Item=move_2.Geometry, Indices=item_4, Wrap=False)

# ---- group: adjusted spacing offset
subtraction_6 = Subtraction(A=larger_spacing, B=even_spacing)
subtraction_7 = Subtraction(A=smaller_spacing, B=even_spacing)
addition_3 = Addition(A=subtraction_6, B=subtraction_7)
total_height = Integer(dist)
word_count_6 = Integer(word_count_5)
addition_4 = Addition(A=addition_3, B=total_height)
division_4 = Division(A=addition_4, B=word_count_6)
subtraction_8 = Subtraction(A=even_spacing, B=division_4)
item_8 = ListItem(List=rowpts_2, Index=panel_7, Wrap=True)
pdecon_4 = Deconstruct(Point=item_8)  # -> XComponent, YComponent, ZComponent
addition_5 = Addition(A=pdecon_4.YComponent, B=subtraction_8)
pt = ConstructPoint(XCoordinate=pdecon_4.XComponent, YCoordinate=addition_5, ZCoordinate=pdecon_4.ZComponent)

# ----
replace_3 = ReplaceItems(List=replace_2, Item=pt, Indices=panel_7, Wrap=False)
adjustedpts = Point(replace_3)
points_2 = PointList(Points=adjustedpts, Tags=True, Lines=True, Size=Slider(21, range=0..100))

# ---- group: move msg to new, adjusted points
msg_2 = Curve(c_script.A)
textpt_2 = Point(txtpt)
rowpts_3 = Point(adjustedpts)
shift_2 = ShiftList(List=rowpts_3, Shift=1, Wrap=False)
ln_2 = Line(StartPoint=textpt_2, EndPoint=shift_2)  # -> graft(Line)
move_4 = Move(Geometry=msg_2, Motion=ln_2)  # -> Geometry, Transform

# ---- group: center on the work plane
X_2 = UnitX(Factor=subtraction_4)

# ---- group: scale to new, adjusted points
shift_3 = ShiftList(List=adjustedpts, Shift=-1, Wrap=False)
shift_4 = ShiftList(List=adjustedpts, Shift=1, Wrap=False)
words = Curve(move_4.Geometry)
dist_2 = Distance(PointA=shift_3, PointB=shift_4)

# ---- group: scale to new, adjusted points / line spacing
textheight = Integer(number_slider)
division_5 = Division(A=dist_2, B=textheight)
scalar = Multiplication(A=division_5, B=Slider(0.8, range=0..1))

# ---- group: scale to new, adjusted points (continued)
scale = Scale(Geometry=simplify(words), Center=graft(shift_4), Factor=graft(scalar))  # -> Geometry, Transform

# ----
letter_curves = Curve(simplify(scale.Geometry))

# ---- group: Last letter
lng_4 = ListLength(List=letter_curves)
item_9 = ListItem(List=letter_curves, Index=expr("i-1", lng_4), Wrap=True)
cpoly = ControlPolygon(Curve=item_9)  # -> Polygon, Points
pcen = PolygonCenter(Polyline=cpoly.Polygon)  # -> CenterV, CenterE
pt_2 = Point(pcen.CenterV)

# ---- group: 1st letter
item_10 = ListItem(List=letter_curves, Index=0, Wrap=True)
cpoly_2 = ControlPolygon(Curve=item_10)  # -> Polygon, Points
pcen_2 = PolygonCenter(Polyline=cpoly_2.Polygon)  # -> CenterV, CenterE
pt_3 = Point(pcen_2.CenterV)

# ---- group: midPt of word
dist_3 = Distance(PointA=pt_3, PointB=pt_2)
division_6 = Division(A=dist_3, B=Slider(1.712, range=0..10))

# ----
panel_8 = Panel(division_6)

# ---- group: center on the work plane (continued)
move_5 = Move(Geometry=letter_curves, Motion=X_2)  # -> Geometry, Transform
X_3 = UnitX(Factor=expr("-1*F", division_6))
move_6 = Move(Geometry=move_5.Geometry, Motion=X_3)  # -> Geometry, Transform

# ---- group: rotate to match robot coordinate system (continued)
words_2 = Curve(move_6.Geometry)
rotax = RotateAxis(Geometry=words_2, Angle=1.570796327, Axis=line)  # -> Geometry, Transform
rotax_2 = RotateAxis(Geometry=rotax.Geometry, Angle=1.570796327, Axis=line_3)  # -> Geometry, Transform

# ---- group: generate toolpath points
cpoly_3 = ControlPolygon(Curve=rotax.Geometry)  # -> Polygon, Points

# ----
# Send toolpaths to back to Processing
address_pattern = Panel("/points")
toolpath_pts = Point(cpoly_3.Points)
add_type_tag = Panel([address_pattern, toolpath_pts])
_1_4 = Integer(1)
address_of_processing_application = Panel("128.237.161.253")
send_pattern_osc_2 = Panel("999")
port_2 = Panel("16001")

# ---- group: use a dummy point to indicate were a curve ends
dummy_spacer_pt = Point(Point(-1, -1, -1))
lng_5 = ListLength(List=add_type_tag)
ins = InsertItems(List=add_type_tag, Item=dummy_spacer_pt, Indices=lng_5, Wrap=False)

# ----
panel_9 = Panel(ins)
flatten = FlattenTree(Tree=panel_9, Path="{0}")
cull_i_2 = CullIndex(List=flatten, Indices=_1_4, Wrap=False)
list_of_all_toolpaths = Panel(cull_i_2)
osc_message = Panel(list_of_all_toolpaths)
udp_2 = UDPSender(Address=address_of_processing_application, Port=port_2, Pattern=send_pattern_osc_2, Data=osc_message)
panel_10 = Panel(udp_2)
