# Grasshopper definition text2toolpath.gh (Grasshopper 0.9.56)
# plug-ins: gHowl

# ---- group: receiving msg from p5
# Receive Tweets from Processing through OSC
netsource = NetworkSource()  # -> NetworkAdapterIsUp, AdapterProperties, LocalIpAddress
address_for_gh = Panel(netsource.LocalIpAddress)
port = Panel("16000")
send_pattern_osc = Panel("999")
udp = UDPReceiver(Address=address_for_gh, Port=port, Pattern=send_pattern_osc)  # -> Info, Data
osc_data = Panel(udp.Data)

# ---- group: get current position of the robot
osc_d = OSCDispatch(OSCDevices="/pos", OSCMessage=osc_data)  # -> OSCDevice, OSCData
robot_currpos = Point(osc_d.OSCData)

# ---- group: get tweeted msg
osc_d_2 = OSCDispatch(OSCDevices="/msg", OSCMessage=osc_data)  # -> OSCDevice, OSCData
tweet = Panel(osc_d_2.OSCData)
split = TextSplit(Text=tweet, Separators=",")
lng = ListLength(List=split)
series = Series(Start=0, Step=1, Count=expr("c-1", lng))
item = ListItem(List=split, Index=series, Wrap=True)

# ----
current_robot_position = Panel(robot_currpos)
sample_text_as_list_of_words = Panel("""I'M AFRAID
I CAN'T DO THAT
DAVE
@madelinegannon""")
message_from_twitter_as_a_list_of_words = Panel(item)
word_count = ListLength(List=sample_text_as_list_of_words)
word_count_2 = ListLength(List=message_from_twitter_as_a_list_of_words)

# ---- group: sample fonts
panel = Panel("League Script Thin")
panel_2 = Panel("VAL")
panel_3 = Panel("Unanimous BRK")
panel_4 = Panel("Sniglet-ExtraBold")

# ----
# Turn Text to Curves
number_slider = Slider(10, range=-30..30)
bool = Boolean(False)

# ---- group: txt2crv (from giuliopiacentino.com/grasshopper-tools)
bool_2 = Boolean(False)
txtpt = Point(Point(0, 0, 0))
c_script = CSharpScript(face=panel_2, bold=bool_2, italics=bool, size=number_slider, content=sample_text_as_list_of_words, pl=txtpt)  # -> out, A; inputs face: String, bold: Boolean, italics: Boolean, size: Double, content: String, pl: Plane
# ---------- c_script: C# ----------
    if(size == 0)
      size = 1;

    if(!string.IsNullOrEmpty(face) && size > 0 && !string.IsNullOrEmpty(content) &&
      pl.IsValid)
    {

      var te = RhinoDoc.ActiveDoc.Objects.AddText(content, pl, size, face, bold, italics);
      Rhino.DocObjects.TextObject txt = RhinoDoc.ActiveDoc.Objects.Find(te) as Rhino.DocObjects.TextObject;

      if(txt != null)
      {
        var tt = txt.Geometry as Rhino.Geometry.TextEntity;
        A = tt.Explode();
      }

      RhinoDoc.ActiveDoc.Objects.Delete(te, true);
    }
# ---------- end c_script ----------

# ---- group: set the origin point
robot_currpos_2 = Point(osc_d.OSCData)
dummypt_6640 = Point(Point(4000, 1350, 1100))
# Dynamic Layout for the Robot
robot_center_point = Point(dummypt_6640)

# ----
dummypt_4400 = Point(Point(-500, -1070, 1570))
word_count_3 = Integer(word_count)

# ----
# create the robot's working (XY) plane
pl = ConstructPlane(Origin=robot_center_point, XAxis=Vector(1, 0, 0), YAxis=Vector(0, 1, 0))
xreach = Slider(393, range=0..1000)
yreach = Slider(350, range=1..1000)
dom = ConstructDomain(DomainStart=expr("-1*A", xreach), DomainEnd=xreach)
dom_2 = ConstructDomain(DomainStart=expr("-1*A", yreach), DomainEnd=yreach)
planesrf = PlaneSurface(Plane=pl, XSize=dom, YSize=dom_2)

panel_5 = Panel("make rows")
word_count_4 = Integer(word_count_3)
sdivide = DivideSurface(Surface=planesrf, UCount=1, VCount=word_count_4)  # -> Points, Normals, Parameters
rev = ReverseList(List=sdivide.Points)  # -> flatten(List)
dom_3 = ConstructDomain(DomainStart=0, DomainEnd=word_count_4)
subset = SubList(List=rev, Domain=dom_3, Wrap=False)  # -> List, Index
points = PointList(Points=subset.List, Tags=True, Lines=True, Size=Slider(20, range=10..50))

# ----
# move each word to a row
msg = Curve(c_script.A)
textpt = Point(txtpt)
rowpts = Point(subset.List)
shift = ShiftList(List=rowpts, Shift=1, Wrap=False)
ln = Line(StartPoint=textpt, EndPoint=shift)  # -> graft(Line)
move = Move(Geometry=msg, Motion=ln)  # -> Geometry, Transform

# ---- group: even spacing
rev_2 = ReverseList(List=rowpts)
item_2 = ListItem(List=rev_2, Index=0, Wrap=True)
item_3 = ListItem(List=rowpts, Index=0, Wrap=True)
dist = Distance(PointA=item_3, PointB=item_2)
lng_2 = ListLength(List=rev_2)
_1 = Integer(1)
subtraction = Subtraction(A=lng_2, B=_1)
division = Division(A=dist, B=subtraction)

# ----
series_2 = Series(Start=30, Step=1, Count=10)
series_3 = Series(Start=0, Step=1, Count=11)
series_4 = Series(Start=11, Step=1, Count=14)
series_5 = Series(Start=25, Step=1, Count=5)
series_6 = Series(Start=40, Step=1, Count=8)
series_7 = Series(Start=43, Step=1, Count=9)

# ---- group: midPt of working plane
working_plane = Surface(planesrf)
area = Area(Geometry=working_plane)  # -> Area, Centroid
pdecon = Deconstruct(Point=area.Centroid)  # -> XComponent, YComponent, ZComponent

# ----
plane_corner = ListItem(List=rowpts, Index=0, Wrap=True)
pdecon_2 = Deconstruct(Point=plane_corner)  # -> XComponent, YComponent, ZComponent
subtraction_2 = Subtraction(A=pdecon.XComponent, B=pdecon_2.XComponent)

panel_6 = Panel("center each word")

# ----
# scale each word based on column height
# Adjust SEED value to see alternative layouts.
number_slider_2 = Slider(14, range=0..50)
even_spacing = Number(division)
rowpts_2 = Point(rowpts)

# ---- group: select 2 random indices to vertically adjust
word_count_5 = Integer(word_count_3)
_2 = Integer(2)
_1_2 = Integer(1)
random = Random(Range=Domain(0, 1), Number=_2, Seed=number_slider_2)
subtraction_3 = Subtraction(A=word_count_5, B=_1_2)
multiplication = Multiplication(A=random, B=subtraction_3)
_1_3 = Integer(1)
integer_division = IntegerDivision(A=multiplication, B=_1_3)
panel_7 = Panel(integer_division)

# ---- group: rest of indices to adjust
lng_3 = ListLength(List=rowpts)
series_8 = Series(Start=1, Step=1, Count=expr("c-2", lng_3))
cull_i = CullIndex(List=series_8, Indices=expr("i-1", panel_7), Wrap=False)
panel_8 = Panel(cull_i)

# ---- group: smaller spacing
item_4 = ListItem(List=panel_7, Index=1, Wrap=True)
division_2 = Division(A=even_spacing, B=Slider(4.8, range=0.1..10))
Y = UnitY(Factor=expr("-1*F", division_2))
item_5 = ListItem(List=rowpts, Index=item_4, Wrap=True)
move_2 = Move(Geometry=item_5, Motion=Y)  # -> Geometry, Transform

# ---- group: larger spacing
item_6 = ListItem(List=panel_7, Index=0, Wrap=True)
division_3 = Division(A=even_spacing, B=Slider(6.3, range=0.1..10))
item_7 = ListItem(List=rowpts, Index=item_6, Wrap=True)
Y_2 = UnitY(Factor=division_3)
move_3 = Move(Geometry=item_7, Motion=Y_2)  # -> Geometry, Transform

# ---- group: rotate to match robot coordinate system
robot_center_point_2 = Point(robot_center_point)
X = UnitX(Factor=1)
line = LineSDL(Start=robot_center_point_2, Direction=X, Length=1)
Y_3 = UnitY(Factor=1)
Z = UnitZ(Factor=1)
line_2 = LineSDL(Start=robot_center_point_2, Direction=Y_3, Length=1)
line_3 = LineSDL(Start=robot_center_point_2, Direction=Z, Length=1)

# ----
larger_spacing = Number(division_3)
smaller_spacing = Number(division_2)
replace = ReplaceItems(List=rowpts_2, Item=move_3.Geometry, Indices=item_6, Wrap=False)
replace_2 = ReplaceItems(List=replace, Item=move_2.Geometry, Indices=item_4, Wrap=False)

# ---- group: adjusted spacing offset
subtraction_4 = Subtraction(A=larger_spacing, B=even_spacing)
subtraction_5 = Subtraction(A=smaller_spacing, B=even_spacing)
addition = Addition(A=subtraction_4, B=subtraction_5)
total_height = Integer(dist)
word_count_6 = Integer(word_count_5)
addition_2 = Addition(A=addition, B=total_height)
division_4 = Division(A=addition_2, B=word_count_6)
subtraction_6 = Subtraction(A=even_spacing, B=division_4)
item_8 = ListItem(List=rowpts_2, Index=panel_8, Wrap=True)
pdecon_3 = Deconstruct(Point=item_8)  # -> XComponent, YComponent, ZComponent
addition_3 = Addition(A=pdecon_3.YComponent, B=subtraction_6)
pt = ConstructPoint(XCoordinate=pdecon_3.XComponent, YCoordinate=addition_3, ZCoordinate=pdecon_3.ZComponent)

# ----
replace_3 = ReplaceItems(List=replace_2, Item=pt, Indices=panel_8, Wrap=False)
adjustedpts = Point(replace_3)
points_2 = PointList(Points=adjustedpts, Tags=True, Lines=True, Size=Slider(20, range=0..100))

# ---- group: move msg to new, adjusted points
msg_2 = Curve(c_script.A)
textpt_2 = Point(txtpt)
rowpts_3 = Point(adjustedpts)
shift_2 = ShiftList(List=rowpts_3, Shift=1, Wrap=False)
ln_2 = Line(StartPoint=textpt_2, EndPoint=shift_2)  # -> graft(Line)
move_4 = Move(Geometry=msg_2, Motion=ln_2)  # -> Geometry, Transform

# ---- group: center on the work plane
X_2 = UnitX(Factor=subtraction_2)

# ---- group: scale to new, adjusted points
shift_3 = ShiftList(List=adjustedpts, Shift=-1, Wrap=False)
shift_4 = ShiftList(List=adjustedpts, Shift=1, Wrap=False)
words = Curve(move_4.Geometry)
dist_2 = Distance(PointA=shift_3, PointB=shift_4)

# ---- group: scale to new, adjusted points / line spacing
textheight = Integer(number_slider)
division_5 = Division(A=dist_2, B=textheight)
scalar = Multiplication(A=division_5, B=Slider(0.9, range=0..1))

# ---- group: scale to new, adjusted points (continued)
scale = Scale(Geometry=simplify(words), Center=graft(shift_4), Factor=graft(scalar))  # -> Geometry, Transform

# ----
letter_curves = Curve(simplify(scale.Geometry))

# ---- group: Last letter
lng_4 = ListLength(List=letter_curves)
# generate toolpaths from letters
item_9 = ListItem(List=letter_curves, Index=expr("i-1", lng_4), Wrap=True)
cpoly = ControlPolygon(Curve=item_9)  # -> Polygon, Points
pcen = PolygonCenter(Polyline=cpoly.Polygon)  # -> CenterV, CenterE
pt_2 = Point(pcen.CenterV)

# ---- group: 1st letter
item_10 = ListItem(List=letter_curves, Index=0, Wrap=True)
cpoly_2 = ControlPolygon(Curve=item_10)  # -> Polygon, Points
pcen_2 = PolygonCenter(Polyline=cpoly_2.Polygon)  # -> CenterV, CenterE
pt_3 = Point(pcen_2.CenterV)

# ---- group: midPt of word
dist_3 = Distance(PointA=pt_3, PointB=pt_2)
division_6 = Division(A=dist_3, B=Slider(2.184, range=0..10))

# ----
panel_9 = Panel(division_6)

# ---- group: center on the work plane (continued)
move_5 = Move(Geometry=letter_curves, Motion=X_2)  # -> Geometry, Transform
X_3 = UnitX(Factor=expr("-1*F", division_6))
move_6 = Move(Geometry=move_5.Geometry, Motion=X_3)  # -> Geometry, Transform

# ---- group: rotate to match robot coordinate system (continued)
words_2 = Curve(move_6.Geometry)
rotax = RotateAxis(Geometry=words_2, Angle=1.570796327, Axis=line)  # -> Geometry, Transform
rotax_2 = RotateAxis(Geometry=rotax.Geometry, Angle=3.141592654, Axis=line_3)  # -> Geometry, Transform

# ---- group: generate toolpath points
cpoly_3 = ControlPolygon(Curve=rotax.Geometry)  # -> Polygon, Points

# ----
points_3 = PointList(Points=cpoly_3.Points, Tags=True, Lines=True, Size=Slider(10, range=1..100))

# ---- group: divide curves into points
crv = Curve(rotax_2.Geometry)

# ----
beautiful = ListItem(List=flatten(crv), Index=series_2, Wrap=False)
hello = ListItem(List=flatten(crv), Index=series_3, Wrap=False)
there = ListItem(List=flatten(crv), Index=series_4, Wrap=False)
beautiful_2 = ListItem(List=flatten(crv), Index=series_5, Wrap=False)
at_mad = ListItem(List=flatten(crv), Index=series_6, Wrap=False)
at_mad_2 = ListItem(List=flatten(crv), Index=series_7, Wrap=False)
crv_2 = Curve(at_mad)

# ---- group: divide curves into points (continued)
divide = DivideCurve(Curve=crv_2, Count=10, Kinks=False)  # -> Points, Tangents, Parameters
topoly = CurveToPolyline(Curve=crv_2, ToleranceDistance=0, ToleranceAngle=0, MaxEdge=Slider(35, range=1..50))  # -> Polyline, Segments
cp = ControlPoints(Curve=topoly.Polyline)  # -> Points, Weights, Knots
points_4 = PointList(Points=cp.Points, Tags=True, Lines=True, Size=Slider(10, range=1..10))

# ----
panel_10 = Panel(cp.Points)
pt_4 = Point(cp.Points)

# ---- group: CALIBRATE THE ROBOT WORKING AREA
robot_center_point_3 = Point(robot_center_point)
X_4 = UnitX(Factor=1)
line_4 = LineSDL(Start=robot_center_point_3, Direction=X_4, Length=1)
srf = Surface(planesrf)
rotax_3 = RotateAxis(Geometry=srf, Angle=1.570796327, Axis=line_4)  # -> Geometry, Transform
edges = BrepEdges(Brep=rotax_3.Geometry)  # -> Naked, Interior, NonManifold
end = EndPoints(Curve=edges.Naked)  # -> Start, End
robot_work_area_corners = Point(end.Start)
points_5 = PointList(Points=end.Start, Tags=True, Lines=True, Size=Slider(98, range=0..100))

# ----
# Send toolpaths to back to Processing
# Light Drawing Procedure for toolpaths: (1) GO TO start of curve
# (2) TURN LIGHT ON (a.k.a., send {-1,-1,-1} point)
# (3) DRAW CURVE
# (4) TURN LIGHT OFF (send another {-1,-1,-1} point)
address_pattern = Panel("/points")
toolpath_pts = Point(pt_4)
pdecon_4 = Deconstruct(Point=toolpath_pts)  # -> XComponent, YComponent, ZComponent
round = Round(Number=pdecon_4.XComponent)  # -> Nearest, Floor, Ceiling
round_2 = Round(Number=pdecon_4.YComponent)  # -> Nearest, Floor, Ceiling
round_3 = Round(Number=pdecon_4.ZComponent)  # -> Nearest, Floor, Ceiling
pt_5 = ConstructPoint(XCoordinate=round.Nearest, YCoordinate=round_2.Nearest, ZCoordinate=round_3.Nearest)
add_type_tag = Panel([address_pattern, pt_5])
address_of_processing_application = Panel("128.2.109.103")
send_pattern_osc_2 = Panel("999")
port_2 = Panel("16001")

# ---- group: CALIBRATE THE ROBOT WORKING AREA (continued)
add_type_tag_2 = Panel([address_pattern, robot_work_area_corners])
flatten = FlattenTree(Tree=add_type_tag_2, Path="{0}")
panel_11 = Panel(flatten)

# ---- group: use a dummy point to indicate were a curve ends
lng_5 = ListLength(List=add_type_tag)
dummy_spacer_pt = Point(Point(-1, -1, -1))
ins = InsertItems(List=lng_5, Indices=0, Wrap=False)
ins_2 = InsertItems(List=add_type_tag, Item=dummy_spacer_pt, Indices=ins, Wrap=False)

# ----
calibration_points = Text(panel_11)

panel_12 = Panel(ins)
panel_13 = Panel(ins_2)

# ---- group: send robot to start of curve before turning on light
item_11 = ListItem(List=panel_13, Index=1, Wrap=True)
_0 = Integer(0)
ins_3 = InsertItems(List=panel_13, Item=item_11, Indices=_0, Wrap=True)

# ---- group: clean up start of list
flatten_2 = FlattenTree(Tree=ins_3, Path="{0}")
series_9 = Series(Start=1, Step=1, Count=3)
cull_i_2 = CullIndex(List=flatten_2, Indices=series_9, Wrap=True)

# ----
list_of_all_toolpaths = Panel(cull_i_2)
flatten_3 = FlattenTree(Tree=list_of_all_toolpaths, Path="{0}")
toolpath_points = Text(flatten_3)
osc_message = Panel(toolpath_points)
udp_2 = UDPSender(Address=address_of_processing_application, Port=port_2, Pattern=send_pattern_osc_2, Data=osc_message)
panel_14 = Panel(udp_2)
