# Grasshopper definition vector2toolpath.gh (Grasshopper 0.9.56)
# plug-ins: gHowl

sample_text_as_list_of_words = Panel("""AFFDE
DBCEA
E@
EBC@AD""")
word_count = ListLength(List=sample_text_as_list_of_words)

# ---- group: sample fonts
panel = Panel("Moon Flower")
panel_2 = Panel("Sniglet-ExtraBold")
panel_3 = Panel("Untitled1")

# ----
# Turn Text to Curves
number_slider = Slider(10, range=-30..30)
bool = Boolean(False)

# ---- group: txt2crv (from giuliopiacentino.com/grasshopper-tools)
bool_2 = Boolean(False)
txtpt = Point(Point(0, 0, 0))
c_script = CSharpScript(face=panel_2, bold=bool_2, italics=bool, size=number_slider, content=sample_text_as_list_of_words, pl=txtpt)  # -> out, A; inputs face: String, bold: Boolean, italics: Boolean, size: Double, content: String, pl: Plane
# ---------- c_script: C# ----------
    if(size == 0)
      size = 1;

    if(!string.IsNullOrEmpty(face) && size > 0 && !string.IsNullOrEmpty(content) &&
      pl.IsValid)
    {

      var te = RhinoDoc.ActiveDoc.Objects.AddText(content, pl, size, face, bold, italics);
      Rhino.DocObjects.TextObject txt = RhinoDoc.ActiveDoc.Objects.Find(te) as Rhino.DocObjects.TextObject;

      if(txt != null)
      {
        var tt = txt.Geometry as Rhino.Geometry.TextEntity;
        A = tt.Explode();
      }

      RhinoDoc.ActiveDoc.Objects.Delete(te, true);
    }
# ---------- end c_script ----------

# ---- group: set the origin point
robot_currpos = Point()
dummypt_6640 = Point(Point(4000, 1650, 1100))
robot_center_point = Point(dummypt_6640)

# ----
dummypt_4400 = Point(Point(-500, -1070, 1570))

# ----
# create the robot's working (XY) plane
pl = ConstructPlane(Origin=robot_center_point, XAxis=Vector(1, 0, 0), YAxis=Vector(0, 1, 0))
xreach = Slider(350, range=0..1000)
yreach = Slider(400, range=1..1000)
dom = ConstructDomain(DomainStart=expr("-1*A", xreach), DomainEnd=xreach)
dom_2 = ConstructDomain(DomainStart=expr("-1*A", yreach), DomainEnd=yreach)
planesrf = PlaneSurface(Plane=pl, XSize=dom, YSize=dom_2)

# ---- group: divide curves into points
crv = Curve([<curve referenced from the Rhino model> x3])
divide = DivideCurve(Curve=crv, Count=10, Kinks=False)  # -> Points, Tangents, Parameters
topoly = CurveToPolyline(Curve=crv, ToleranceDistance=0, ToleranceAngle=0, MaxEdge=Slider(35.71, range=1..50))  # -> Polyline, Segments
cp = ControlPoints(Curve=topoly.Polyline)  # -> Points, Weights, Knots
points = PointList(Points=cp.Points, Tags=True, Lines=True, Size=Slider(10, range=1..10))

# ----
panel_4 = Panel(cp.Points)

# ---- group: turn light on
# Send toolpaths to back to Processing
# Light Drawing Procedure for toolpaths: (1) GO TO start of curve
# (2) TURN LIGHT ON (a.k.a., send {-1,-1,-1} point)
# (3) DRAW CURVE
# (4) TURN LIGHT OFF (send another {-1,-1,-1} point)
address_pattern = Panel("/points")
toolpath_pts = Point(cp.Points)
pdecon = Deconstruct(Point=toolpath_pts)  # -> XComponent, YComponent, ZComponent
round = Round(Number=pdecon.XComponent)  # -> Nearest, Floor, Ceiling
round_2 = Round(Number=pdecon.YComponent)  # -> Nearest, Floor, Ceiling
round_3 = Round(Number=pdecon.ZComponent)  # -> Nearest, Floor, Ceiling
pt = ConstructPoint(XCoordinate=round.Nearest, YCoordinate=round_2.Nearest, ZCoordinate=round_3.Nearest)
address_of_processing_application = Panel("128.2.109.107")
send_pattern_osc = Panel("999")
port = Panel("16001")

# ---- group: CALIBRATE THE ROBOT WORKING AREA
robot_center_point_2 = Point(robot_center_point)
X = UnitX(Factor=1)
line = LineSDL(Start=robot_center_point_2, Direction=X, Length=1)
srf = Surface(planesrf)
rotax = RotateAxis(Geometry=srf, Angle=1.570796327, Axis=line)  # -> Geometry, Transform
edges = BrepEdges(Brep=rotax.Geometry)  # -> Naked, Interior, NonManifold
end = EndPoints(Curve=edges.Naked)  # -> Start, End
robot_work_area_corners = Point(end.Start)
points_2 = PointList(Points=end.Start, Tags=True, Lines=True, Size=Slider(98, range=0..100))
add_type_tag = Panel([address_pattern, robot_work_area_corners])
flatten = FlattenTree(Tree=add_type_tag, Path="{0}")
panel_5 = Panel(flatten)

# ---- group: turn light on / use a dummy point to indicate were a curve ends
lng = ListLength(List=pt)
dummy_spacer_pt = Point(Point(-1, -1, -1))
ins = InsertItems(List=lng, Indices=0, Wrap=False)
ins_2 = InsertItems(List=pt, Item=dummy_spacer_pt, Indices=lng, Wrap=False)

# ----
calibration_points = Text(panel_5)

# ---- group: turn light on (continued)
panel_6 = Panel(ins_2)

# ---- group: turn light on / duplicate start point to send robot to before turning on light
item = ListItem(List=panel_6, Index=0, Wrap=True)
_0 = Integer(0)
ins_3 = InsertItems(List=panel_6, Item=item, Indices=_0, Wrap=True)

# ----
ins_4 = InsertItems(List=ins_3, Item=dummy_spacer_pt, Indices=expr("i+1", _0), Wrap=True)

# ---- group: turn light on (continued)
flatten_2 = FlattenTree(Tree=ins_4, Path="{0}")

# ----
ins_5 = InsertItems(List=flatten_2, Item=address_pattern, Indices=_0, Wrap=True)

# ---- group: turn light on (continued)
list_of_all_toolpaths = Panel(ins_5)
flatten_3 = FlattenTree(Tree=list_of_all_toolpaths, Path="{0}")
toolpath_points = Text(flatten_3)
osc_message = Panel(toolpath_points)
udp = UDPSender(Address=address_of_processing_application, Port=port, Pattern=send_pattern_osc, Data=osc_message)
panel_7 = Panel(udp)
